# Grasshopper definition 221217_Substructure_Diagrams.ghx (Grasshopper 1.0.7)
# plug-ins: Pufferfish, Human

# ---- group: MAS Multi-Agent-System Generation
dom = ConstructDomain(DomainStart=Slider(0.18, range=0..1), DomainEnd=Slider(0.3, range=0..1))
random = Random(Range=dom, Number=Slider(4, range=0..10), Seed=Slider(2, range=0..10))

# ---- group: MAS Multi-Agent-System Generation / num. agents in each cluster
genes = GenePool(Decimals=0, Maximum=20, Minimum=0, Value=[7, 7, 7, 6])

# ---- group: MAS Multi-Agent-System Generation / No. Clusters
number_of_clusters = Panel("4")

# ---- group: MAS Multi-Agent-System Generation
range = Range(Domain=Domain(0, 1), Steps=genes)
bang = ExplodeTree(Data=range)  # -> Branch0, Branch1, Branch2, Branch3

# ---- group: MAS Multi-Agent-System Generation / Target factor
graph = GraphMapper(bang.Branch1, x0=0, x1=1, y0=0, y1=1, Ox=0.5098851919, Oy=1, Px=1, Py=0.1483525634, container_name="Parabola")
graph_2 = GraphMapper(bang.Branch3, x0=0, x1=1, y0=0, y1=1, Cx=0.5553172827, Cy=0.8992747664, container_name="Conic")
graph_3 = GraphMapper(bang.Branch0, x0=0, x1=1, y0=0, y1=1, container_name="Bezier", cpx=[0, 0.5243950486, 0.3017984927, 1], cpy=[0, 0, 1, 1])
graph_4 = GraphMapper(
    bang.Branch2,
    x0=0,
    x1=1,
    y0=0,
    y1=1,
    container_name="Sinc",
    Equation_X0=0.4748720825,
    Equation_X1=1,
    Equation_Y0=0.9733063579,
    Equation_Y1=0.1758453846)
merge = Merge(Data1=graph_3, Data2=graph, Data3=graph_4, Data4=graph_2)
bnd = Bounds(Numbers=merge)
remap = RemapNumbers(Value=merge, Source=bnd, Target=Domain(0, 1))  # -> Mapped, Clipped

# ---- group: MAS Multi-Agent-System Generation / surface Candidates
geometry = Geometry(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)
geometry_2 = Geometry(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)
geometry_3 = Geometry(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)
geometry_4 = Geometry(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)
geometry_5 = Geometry(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)

# ----
srf = Surface(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)

# ---- group: MAS Multi-Agent-System Generation / Main Function
shift_factor_down = Slider(0.3, range=0.001..0.88)
number_slider = Slider(10, range=10..20)
shift_factor_up = Slider(0.1, range=0.001..0.88)
sub_goal_rad = Slider(20, range=0..100)
sub_goal_fac = Slider(7, range=0..10)

number_slider_2 = Slider(3, range=1..11)
number_slider_3 = Slider(22, range=0..100)
rebuild_toggle = BooleanToggle(True)

t1 = Slider(157, range=0..500)
t2 = Slider(600, range=0..800)

coherence_rad = Slider(13, range=0..100)
avoid_rad = Slider(20, range=0..100)
coherence_fac = Slider(0.2, range=0..3)
align_rad = Slider(10, range=0..100)
align_fac = Slider(0.8, range=0..1)
avoid_fac = Slider(1.5, range=0..3)
coherence_2_toggle = BooleanToggle(True)
separation2_toggle = BooleanToggle(True)
alignment_2_toggle = BooleanToggle(True)

coherence_rad_2 = Slider(58, range=0..100)
coherence_fac_2 = Slider(1, range=0..3)
align_rad_2 = Slider(46, range=0..100)
align_fac_2 = Slider(0.7, range=0..1)
avoid_rad_2 = Slider(10, range=0..100)
avoid_fac_2 = Slider(0.7, range=0..3)
separation_toggle = BooleanToggle(True)
coherence_toggle = BooleanToggle(True)
alignment_toggle = BooleanToggle(True)

# ----
number_slider_4 = Slider(12, range=1..20)
range_2 = Range(Domain=Domain(0, 1), Steps=expr("x-1", number_slider_4))
graph_5 = GraphMapper(
    reverse(range_2),
    x0=0,
    x1=1,
    y0=0,
    y1=1,
    container_name="Bezier",
    cpx=[0, 0.4317768514, 0.5574278831, 1],
    cpy=[0, 0.03870689869, 0.949685812, 1])

min_radius = Slider(2.168, range=0..10)

brep = Brep(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)
md_slider = MDSlider(SliderMode=0, slider_value=Point(0, 0, 0.5), x_domain=Domain(0, 1), y_domain=Domain(0, 1), z_domain=Domain(0, 1))

# ---- group: MAS Multi-Agent-System Generation
# Multi Agent System
genes_2 = GenePool(Decimals=2, Maximum=1, Minimum=0, Value=[0, 0.28, 0.61, 0.87])
ghpython_script = GhPythonScript(centers=genes_2, extend=random)  # -> out, intervals; inputs centers: list, extend: list
# ---------- ghpython_script: Python ----------
import math
import ghpythonlib.treehelpers as th


intervals=[]

for center, ext in zip(centers, extend):
    inter_from = center- ext
    inter_to = center + ext
    print type(inter_from)
    if inter_from < 0 : 
        inter_from =0
    if inter_to >1 :
        inter_to =1
    
    intervals.append([inter_from, inter_to])

intervals = th.list_to_tree(intervals)
# ---------- end ghpython_script ----------
# C:\Users\ahmed\OneDrive - Politecnico di Milano\ETH Zurich\MAS Dfab\P4_Mini Project\3d_printing_teamwork\Design_Substructure\221215_Substructure_khara_working.py
panel = Panel("C:\Users\eleni\Documents\GitHub\3d_printing_teamwork\Design_Substructure\221215_Substructure_khara_working.py")
dispatch = Dispatch(List=ghpython_script.intervals, DispatchPattern=[True, False])  # -> ListA, ListB
dom_2 = ConstructDomain(DomainStart=dispatch.ListA, DomainEnd=dispatch.ListB)
read_file = ReadFile(File=panel, PerLineParse=False)
# Surface Generation
surface = Surface(reparameterize(srf))

# ---- group: MAS Multi-Agent-System Generation / u_pos_for_initial_agents
graph_6 = GraphMapper(bang.Branch1, x0=0, x1=1, y0=0, y1=1, Ox=0.4780313373, Oy=1, Px=1, Py=0.1196134686, container_name="Parabola")
graph_7 = GraphMapper(bang.Branch3, x0=0, x1=1, y0=0, y1=1, Cx=0.4874807298, Cy=0.7769420147, container_name="Conic")
graph_8 = GraphMapper(bang.Branch0, x0=0, x1=1, y0=0, y1=1, container_name="Bezier", cpx=[0, 0.5243950486, 0.08604718745, 1], cpy=[0, 0, 1, 1])
graph_9 = GraphMapper(
    bang.Branch2,
    x0=0,
    x1=1,
    y0=0,
    y1=1,
    container_name="Sinc",
    Equation_X0=0.4748720825,
    Equation_X1=0.9382023215,
    Equation_Y0=0.9733063579,
    Equation_Y1=0.2215337157)
merge_2 = Merge(Data1=graph_8, Data2=graph_6, Data3=graph_9, Data4=graph_7)
bnd_2 = Bounds(Numbers=merge_2)
sort = SortList(Keys=merge_2)  # -> Keys, ValuesA
remap_2 = RemapNumbers(Value=sort.Keys, Source=bnd_2, Target=dom_2)  # -> Mapped, Clipped

# ---- group: MAS Multi-Agent-System Generation / Main Function
resolution = Slider(514, range=0..1000)
ghpython_script_2 = GhPythonScript(
    Code=read_file,
    Seeed=Slider(2, range=0..10),
    Time_1=t1,
    Time_2=t2,
    Shift_up_factor=shift_factor_up,
    Shift_down_factor=shift_factor_down,
    Sub_goal_rad=sub_goal_rad,
    Sub_goal_fac=sub_goal_fac,
    Num_new_agents=number_slider,
    Coherence_rad2=coherence_rad,
    Coherence_fac2=coherence_fac,
    Coherence_T2=coherence_2_toggle,
    Align_rad2=align_rad,
    Align_fac2=align_fac,
    Alignment_T2=alignment_2_toggle,
    Avoid_rad2=avoid_rad,
    Avoid_fac2=avoid_fac,
    Separation_T2=separation2_toggle,
    Surface=surface,
    U_div=resolution,
    V_div=resolution,
    U_lists=remap_2.Mapped,
    Target_factors=remap.Clipped,
    Coherence_rad=coherence_rad_2,
    Coherence_fac=coherence_fac_2,
    Coherence_T=coherence_toggle,
    Align_rad=align_rad_2,
    Align_fac=align_fac_2,
    Alignment_T=alignment_toggle,
    Avoid_rad=avoid_rad_2,
    Avoid_fac=avoid_fac_2,
    Separation_T=separation_toggle,
    Rebuild_points=number_slider_3,
    Rebuild_degree=number_slider_2,
    Rebuild_T=rebuild_toggle)  # -> Out, Goals, Main_paths, Up_factors, Sec_paths

# ---- group: MAS Multi-Agent-System Generation (continued)
panel_2 = Panel(ghpython_script_2.Out)
geo = Geometry(ghpython_script_2.Goals)

# ---- group: MAS Multi-Agent-System Generation / Main Agents
up_factors = Data(ghpython_script_2.Up_factors)
curve = Curve(ghpython_script_2.Main_paths)

# ---- group: MAS Multi-Agent-System Generation / Sub Agents
curve_2 = Curve(ghpython_script_2.Sec_paths)

# ----
panel_3 = Panel(up_factors)
custom_preview_lineweights = CustomPreviewLineweights(
    Geometry=curve,
    Shader={diffuse=RGB(255, 105, 180), emission=RGB(76, 32, 54), shine=0.5, specular=RGB(255, 255, 255), transparency=0},
    Absolute=False)
custom_preview_lineweights_2 = CustomPreviewLineweights(
    Geometry=curve,
    Shader={diffuse=RGB(255, 105, 180), emission=RGB(76, 32, 54), shine=0.5, specular=RGB(255, 255, 255), transparency=0},
    Absolute=False)
custom_preview_lineweights_3 = CustomPreviewLineweights(
    Geometry=curve,
    Shader={diffuse=RGB(255, 105, 180), emission=RGB(76, 32, 54), shine=0.5, specular=RGB(255, 255, 255), transparency=0},
    Absolute=False)
custom_preview_lineweights_4 = CustomPreviewLineweights(Geometry=curve, Shader=ColourSwatch(SwatchColor=RGB(0, 0, 0)), Thickness=Slider(5.25, range=0..10), Absolute=True)

# ----
# Pipes- Sub Agents
number_slider_5 = Slider(1.5, range=0..10)
pipe = Pipe(Curve=curve_2, Radius=number_slider_5, Caps=1)  # -> flatten(Pipe)

custom_preview = CustomPreview(Geometry=surface, Material=ColourSwatch(SwatchColor=RGB(255, 255, 255)))

# ----
# Pipes- Main Agents
python = GhPythonScript(
    paths_main=curve,
    count=number_slider_4,
    GM_fac_rad=graph_5,
    radius_fac=up_factors,
    max_radius=Slider(10, range=0..10),
    min_radius=min_radius)  # -> out, a; inputs paths_main: list of Curve, count: Int32, GM_fac_rad: list, radius_fac: list
# ---------- python: Python ----------
import Rhino.Geometry as rg
import ghpythonlib
import math

#for main pipes:

def SetMainPipes(paths, count, max_radius, min_radius, radius_fac, GM_fac_rad):
    #iterate over all paths  
    roots = []
    for i, path in enumerate(paths):
        curves = []
        #divide by count
        params = path.DivideByCount(count-1, True)
        for j, param in enumerate(params):
            #get the 
            center_pt = path.PointAt(param)
            center_plane = rg.Plane(center_pt, rg.Vector3d.XAxis, rg.Vector3d.YAxis)
            #print  radius_fac[i]
            circle = rg.Circle(center_pt, min_radius + (max_radius - min_radius) * radius_fac[i] * GM_fac_rad[j])
            curves.append(circle.ToNurbsCurve())
        loft = rg.Brep.CreateFromLoft(curves, rg.Point3d.Unset,rg.Point3d.Unset,rg.LoftType(1),False)
        print loft[0]
        roots.append(loft[0])
    return roots


a = SetMainPipes(paths_main, count, max_radius, min_radius, radius_fac, GM_fac_rad)
# ---------- end python ----------
panel_4 = Panel(graph_5)

# ---- group: PIpes - Main Agents
cap_holes = CapHoles(Brep=python.a)

# ---- group: Pipes Sub- Agents
brep_2 = Brep(pipe)

# ----
offset = OffsetSurface(Surface=surface, Distance=number_slider_5, Retrim=True)
offsrf = OffsetSurface(Surface=surface, Distance=number_slider_5, BothSides=Slider(-0.5, range=-10..10), CreateSolid=True)
evalsrf = EvaluateSurface(Surface=offset, Point=md_slider)  # -> Point, Normal, UDirection, VDirection, Frame
xy = XYPlane(Origin=evalsrf.Point)
deconstruct = Deconstruct(Point=evalsrf.Point)  # -> XComponent, YComponent, ZComponent
plntrimsrf = PlaneTrimSurface(Surface=brep, Plane=xy, Flip=False)  # -> Trimmed, Intersected
negative = Negative(Value=deconstruct.ZComponent)
geo_2 = Geometry(plntrimsrf.Trimmed)
unit_z = UnitZ(Factor=negative)
move = Move(Geometry=geo_2, Motion=unit_z)  # -> Geometry, Transform
cap_holes_2 = CapHoles(Brep=move.Geometry)
# Surface Generation
brep_3 = Brep(cap_holes_2)
merge_3 = Merge(Data1=brep_3, Data2=cap_holes)  # -> flatten(Result)
panel_5 = Panel(brep_2)
