# Grasshopper definition combine.gh (Grasshopper 1.0.7)

panel = Panel("C:\Users\Zac\Desktop")
read_file = ReadFile(PerLineParse=False)
ghpython_script = GhPythonScript()  # -> Out, OutTemp

# ---- group: single_curve
curve = Curve(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)

# ----
surface = Surface(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)
surface_2 = Surface(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)
point = Point(Point(-556.4288437, 6.329469364, 0))

_0_to_1_00 = Slider(0, range=0..1)
_1_to_100 = Slider(0, range=0..100)
c_script = CSharpScript()  # -> Out, A
geometry = Geometry(<point referenced from the Rhino model>)

# ---- group: INPUT CRV, SRF, PT
geometry_2 = Geometry(<point referenced from the Rhino model>)
curve_2 = Curve(<curve referenced from the Rhino model>)
surface_3 = Surface(<surface referenced from the Rhino model>)

# ----
geometry_3 = Geometry(<curve referenced from the Rhino model>)

planes_spacing = Slider(10, range=0..20)
length = Length(Curve=geometry_3)
division = Division(A=length, B=planes_spacing)
integer = Integer(division)

divide_length = DivideLength(Curve=geometry_3, Length=Slider(3, range=0..10))  # -> Points, Tangents, Parameters
panel_2 = Panel("C:\Users\josep\OneDrive\Desktop\GIT-HUB_Do-Not-MOVE\T1-Mini-Project_non-Planar-3DP\Repository - Teamwork\3d_printing_teamwork\skinPattern\combine.py")

# ---- group: PRINT ADJUSTMENT LAYER VALUES
layer_nbr = Slider(20, range=0..100)

# ---- group: Layer variation plane adjustment
max_layer_height = Slider(1.4, range=0..10)
min_layer_height = Slider(0.8, range=0..10)

# ----
list_length = ListLength(List=divide_length.Points)

# ---- group: ALL PLANES
geometry_4 = Geometry([Point(20.11241087, -268.0994345, 166.8389438), Point(14.91492845, -266.6103508, 160.828328), Point(21.50814431, -265.3542559, 161.5611426), Point(21.37283391, -265.900737, 162.7330684), Point(18.20059355, -264.8780917, 158.4823961), Point(24.26334024, -262.2164061, 155.575904)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])
geometry_5 = Geometry([Point(20.11241087, -268.0994345, 166.8389438), Point(14.91492845, -266.6103508, 160.828328), Point(21.50814431, -265.3542559, 161.5611426), Point(21.37283391, -265.900737, 162.7330684), Point(18.20059355, -264.8780917, 158.4823961), Point(24.26334024, -262.2164061, 155.575904)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])
geometry_6 = Geometry([Point(20.11241087, -268.0994345, 166.8389438), Point(14.91492845, -266.6103508, 160.828328), Point(21.50814431, -265.3542559, 161.5611426), Point(21.37283391, -265.900737, 162.7330684), Point(18.20059355, -264.8780917, 158.4823961), Point(24.26334024, -262.2164061, 155.575904)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])

# ----
series = Series(Start=0, Step=expr("1/x", list_length), Count=list_length)

# ---- group: 10 PLANES
geometry_7 = Geometry([Plane(origin=(20.00949203, -267.6585518, 167.051147), x=(-0.9765919175, -0.212767767, -0.03159278532), y=(0.06244257573, -0.4209748274, 0.9049205045)), Plane(origin=(18.54185183, -253.8058761, 119.1938906), x=(-0.9698341398, -0.2434366882, -0.01266175937), y=(0.01972924504, -0.1301597398, 0.991296726)), Plane(origin=(2.716405825, -255.3842468, 81.32405356), x=(-0.9814958783, -0.1914477887, 0.003685800351), y=(-0.002470917068, 0.03191004211, 0.9994876907)), Plane(origin=(11.45670435, -257.5554686, 131.5667557), x=(-0.9742020149, -0.2245304731, -0.02272665285), y=(0.02265156901, -0.1974803183, 0.9800451165)), Plane(origin=(-4.043541148, -259.012895, 123.1589417), x=(-0.9824954775, -0.1849965287, -0.02188426413), y=(0.007849735981, -0.1584857942, 0.9873300536)), Plane(origin=(-19.7061908, -260.621374, 58.99762091), x=(-0.9917745565, -0.12704108, 0.01561387489), y=(0.0009991609617, 0.1142984493, 0.9934459553))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])
geometry_8 = Geometry([Plane(origin=(20.00949203, -267.6585518, 167.051147), x=(-0.9765919175, -0.212767767, -0.03159278532), y=(0.06244257573, -0.4209748274, 0.9049205045)), Plane(origin=(18.54185183, -253.8058761, 119.1938906), x=(-0.9698341398, -0.2434366882, -0.01266175937), y=(0.01972924504, -0.1301597398, 0.991296726)), Plane(origin=(2.716405825, -255.3842468, 81.32405356), x=(-0.9814958783, -0.1914477887, 0.003685800351), y=(-0.002470917068, 0.03191004211, 0.9994876907)), Plane(origin=(11.45670435, -257.5554686, 131.5667557), x=(-0.9742020149, -0.2245304731, -0.02272665285), y=(0.02265156901, -0.1974803183, 0.9800451165)), Plane(origin=(-4.043541148, -259.012895, 123.1589417), x=(-0.9824954775, -0.1849965287, -0.02188426413), y=(0.007849735981, -0.1584857942, 0.9873300536)), Plane(origin=(-19.7061908, -260.621374, 58.99762091), x=(-0.9917745565, -0.12704108, 0.01561387489), y=(0.0009991609617, 0.1142984493, 0.9934459553))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])
geometry_9 = Geometry([Plane(origin=(20.00949203, -267.6585518, 167.051147), x=(-0.9765919175, -0.212767767, -0.03159278532), y=(0.06244257573, -0.4209748274, 0.9049205045)), Plane(origin=(18.54185183, -253.8058761, 119.1938906), x=(-0.9698341398, -0.2434366882, -0.01266175937), y=(0.01972924504, -0.1301597398, 0.991296726)), Plane(origin=(2.716405825, -255.3842468, 81.32405356), x=(-0.9814958783, -0.1914477887, 0.003685800351), y=(-0.002470917068, 0.03191004211, 0.9994876907)), Plane(origin=(11.45670435, -257.5554686, 131.5667557), x=(-0.9742020149, -0.2245304731, -0.02272665285), y=(0.02265156901, -0.1974803183, 0.9800451165)), Plane(origin=(-4.043541148, -259.012895, 123.1589417), x=(-0.9824954775, -0.1849965287, -0.02188426413), y=(0.007849735981, -0.1584857942, 0.9873300536)), Plane(origin=(-19.7061908, -260.621374, 58.99762091), x=(-0.9917745565, -0.12704108, 0.01561387489), y=(0.0009991609617, 0.1142984493, 0.9934459553))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])

# ----
read_file_2 = ReadFile(File=panel_2, PerLineParse=False)
entwine = Entwine(Branch00=geometry_8, Branch01=geometry_7, Branch02=geometry_9, FlattenInputs=True)  # -> simplify(Result)
graph_mapper = GraphMapper(series, x0=0, x1=1, y0=0, y1=1, container_name="Bezier", cpx=[0, 1, 0.5469563603, 1], cpy=[0, 0, 0.9756522775, 1])
ghpython_script_2 = GhPythonScript(
    Code=read_file_2,
    List_pts=divide_length.Points,
    Srf=surface_3,
    Flip_vect=Toggle(False),
    Layer_nbr=layer_nbr,
    Plns_height_pt=geometry,
    Plns_dir_pt=geometry_2,
    Min_layer_height=min_layer_height,
    Max_layer_height=max_layer_height,
    GraphMapper=graph_mapper,
    Ratio="0.5")  # -> Out, Pts_divisions, Pts_planes, Moved_planes, Layered_planes
param_viewer = ParamViewer(entwine)
panel_3 = Panel(entwine)
geometry_10 = Geometry(ghpython_script_2.Pts_divisions)
geometry_11 = Geometry(ghpython_script_2.Pts_planes)
geometry_12 = Geometry(ghpython_script_2.Moved_planes)
geometry_13 = Geometry(ghpython_script_2.Layered_planes)
panel_4 = Panel(ghpython_script_2.Out)

list_item = ListItem(List=geometry_13, Index=Slider(1000, range=0..1000), Wrap=True)

panel_5 = Panel(geometry_12)
