# Grasshopper definition skinPattern.ghx (Grasshopper 1.0.7)
# plug-ins: ScriptParasite

ziteration = Slider(54, range=0..300)
maxradius = Slider(7, range=0..10)
mimradius = Slider(1, range=0..10)
filletratio = Slider(0.38, range=0..1)
reset = Button()
curve = Curve(<curve referenced from the Rhino model>)
point = Point(<point referenced from the Rhino model>)
geometry = Geometry(<curve referenced from the Rhino model>)
geometry_2 = Geometry(<curve referenced from the Rhino model>)
panel = Panel("C:\Zac\GitHub\3d_printing_teamwork\skinPattern\circleTangent")
construct_point = ConstructPoint(XCoordinate=Slider(0, range=0..100), YCoordinate=Slider(0, range=0..100), ZCoordinate=0)
tangent_arcs = TangentArcs(CircleA=geometry, CircleB=geometry_2, Radius=Slider(18, range=0..100))  # -> ArcA, ArcB
c_script = CSharpScript(X=geometry, Y=geometry_2)  # -> Out, A
construct_point_2 = ConstructPoint(XCoordinate=Slider(57, range=0..100), YCoordinate=Slider(52, range=0..100), ZCoordinate=0)
tangent_lines_ex = TangentLinesEx(CircleA=geometry, CircleB=geometry_2)  # -> Tangent1, Tangent2
tangent_lines_in = TangentLinesIn(CircleA=geometry, CircleB=geometry_2)  # -> Tangent1, Tangent2
circle = Circle(Plane=construct_point, Radius=Slider(39, range=0..100))
circle_2 = Circle(Plane=construct_point_2, Radius=Slider(27, range=0..100))
number_slider = Slider(10, range=0..10)

panel_2 = Panel("skinPattern\skinPattern.py")  # disabled
ghpython_script = GhPythonScript(file_name=panel_2)  # -> path; disabled
# ---------- ghpython_script: Python ----------
a = ghdoc.Path

path = a.split('3d_printing_teamwork')[0]+r'3d_printing_teamwork\\'+file_name
# ---------- end ghpython_script ----------
read_file = ReadFile(File=ghpython_script, PerLineParse=False)  # disabled

curve_2 = Curve(<curve referenced from the Rhino model>)
divide_curve = DivideCurve(Curve=curve_2, Count=Slider(50, range=0..100), Kinks=False)  # -> Points, Tangents, Parameters

c_script_2 = CSharpScript(
    Points=divide_curve.Points,
    Iteration=ziteration,
    MaxRadius=maxradius,
    MinRadius=mimradius,
    AttractPoint=point,
    Edge=curve,
    MaxCount="200",
    FilletRatio=filletratio)  # -> out, OutPoints, Radiuses, OutTemp; inputs Points: list of Point3d, Iteration: Double, MaxRadius: Double, MinRadius: Double, AttractPoint: Point3d, Edge: Curve, MaxCount: Int32, FilletRatio: Double
# ---------- c_script_2: C# ----------
    // !Initialization
    List<Circle> circles = new List<Circle>();
    List<double> radiuses = new List<double>();


    for (int i = 0; i < Points.Count; i++)
    {
      radiuses.Add(Remap(Points[i].DistanceTo(AttractPoint), 20, 0, MinRadius, MaxRadius));
    }

    //!Iteration
    for (int iteration = 0; iteration < Iteration; iteration++)
    {

      List<Vector3d> totalVector = new List<Vector3d>();
      List<double> counts = new List<double>();
      for (int i = 0; i < Points.Count; i++)
      {
        totalVector.Add(new Vector3d(0, 0, 0));
        counts.Add(0);
      }

      for (int i = 0; i < Points.Count; i++)
        for (int j = i + 1; j < Points.Count; j++)
        {
          double distance = Points[i].DistanceTo(Points[j]);
          if (radiuses[i] + radiuses[j] > distance)
          {

            Vector3d subVector = Points[i] - Points[j];
            subVector.Unitize();
            subVector *= 1 * (radiuses[i] + radiuses[j] - distance);
            // subVector *= 0.5 / distance;
            // subVector *= 
            totalVector[i] += subVector;
            totalVector[j] -= subVector;
            counts[i] += 1;
            counts[j] += 1;

          }


        }


      for (int k = 0; k < Points.Count; k++)
        if (counts[k] != 0)
        {
          if (Edge.Contains(Points[k], Plane.WorldXY, 0.01) == PointContainment.Inside)
          {
            Vector3d move = totalVector[k] / counts[k];
            // Vector3d move = totalVector[k] ;
            Points[k] += move;
          }

        }

      //! Add points
      if (Points.Count < MaxCount)
      {
        List<int> Indices = new List<int>();

        for (int i = 0; i < Points.Count - 1; i++)
        {
          if (Points[i].DistanceTo(Points[i + 1]) > radiuses[i] + radiuses[i + 1])
          { Indices.Add(i + 1 + Indices.Count); }
        }
        foreach (int Index in Indices)
        {
          if (Points.Count < MaxCount)
          {
            Point3d addPoint = 0.5 * (Points[Index - 1] + Points[Index]);
            Points.Insert(Index, addPoint);
          }
        }
      }


      // ! Generate the radius
      radiuses = new List<double>();
      for (int i = 0; i < Points.Count; i++)
      {
        radiuses.Add(Remap(Points[i].DistanceTo(AttractPoint), 20, 0, MinRadius, MaxRadius));
      }

      // Print(totalVector[54].Length.ToString());
    }


    //! Make curve




    //!Info
    Print("Points.Count =" + Points.Count.ToString());
    // ! Output
    // zOutTemp = curves;
    OutPoints = Points;
    Radiuses = radiuses;
# ---------- c_script_2: C# additional code ----------
  bool IsLinear(Point3d p0, Point3d p1, Point3d p2)
  {

    Vector3d v1 = new Vector3d(p1 - p0);
    Vector3d v2 = new Vector3d(p2 - p1);
    

    double x = v1.X / v2.X;

    if (v1.Y / v2.Y == x && v1.Z / v2.Z == x) { return true; }
    else return false;
  }
  double Remap(double x, double t1, double t2, double s1, double s2)
  {
    double mapped = (s2 - s1) / (t2 - t1) * (x - t1) + s1;
    if (mapped < s1) mapped = s1;
    if (mapped > s2) mapped = s2;
    return mapped;
    // return (x - t1) / (t2 - t1) * (s2 - s1) + s1;
  }
# ---------- end c_script_2 ----------
script_parasite = ScriptParasite(Enable=Toggle(False), Folder="C:\Zac\GitHub\3d_printing_teamwork\skinPattern\csharp")

ghpython_script_2 = GhPythonScript(Code=read_file, Points=divide_curve.Points, Reset=reset, Radius=maxradius, Edge=curve, MaxCounts="200")  # -> Out, OutPoints; disabled
panel_3 = Panel(ghpython_script_2.Out)  # disabled

panel_4 = Panel(c_script_2.out)

polyline = PolyLine(Vertices=c_script_2.OutPoints, Closed=False)
geometry_3 = Geometry(c_script_2.OutTemp)
circle_3 = Circle(Plane=c_script_2.OutPoints, Radius=c_script_2.Radiuses)

c_script_3 = CSharpScript(Points=c_script_2.OutPoints, Radius=c_script_2.Radiuses)  # -> out, OutTemp; inputs Points: list of Point3d, Radius: list of Double
# ---------- c_script_3: C# usings ----------
using Rhino.Geometry.Intersect;
# ---------- c_script_3: C# ----------
    double maxTangentArcRadius = 10;
    double minTangentArcRadius = 1;
    Random random = new Random();

    //! Start

    List<NurbsCurve> curves = new List<NurbsCurve>();


    for (int i = 0; i < Points.Count - 1; i++)
    {

      NurbsCurve l0 = new NurbsCurve(0, 0);
      NurbsCurve l1 = new NurbsCurve(0, 0);
      getTangentLineCurves(Points[i], Radius[i], Points[i + 1], Radius[i + 1], out l0, out l1);

      if (l0 == null && l1 == null)
      {
        double radius = maxTangentArcRadius * (random.NextDouble() + minTangentArcRadius);
        getTangentArcs(Points[i], Radius[i], Points[i + 1], Radius[i + 1], radius, out l0, out l1);
      }

      curves.Add(l0);
      curves.Add(l1);
      // Print((curves[curves.Count - 1] == null).ToString());
    }



    OutTemp = curves;
# ---------- c_script_3: C# additional code ----------
  //! Start Tangent Arcs

  void getTangentArcs(Point3d p0, double r0, Point3d p1, double r1, double Radius, out NurbsCurve l0, out NurbsCurve l1)
  {

    double radius = (p0.DistanceTo(p1) - r0 - r1) / 2;
    if (radius < Radius) { radius = Radius; }

    Circle c0 = new Circle(p0, radius);
    Circle c1 = new Circle(p1, radius);

    Point3d intersectionPoint1 = new Point3d();
    Point3d intersectionPoint2 = new Point3d();



    // Print(x);


    l0 = null;
    l1 = null;


  }

  void CircleCircleIntersection(Circle c1, Circle c2)
  {



  }


  //! Start Tangent Lines
  void getTangentLineCurves(Point3d p0, double r0, Point3d p1, double r1, out NurbsCurve l0, out NurbsCurve l1)
  {
    Point3d r2_low_point = new Point3d(p1);
    Point3d r2_up_point = new Point3d(p1);
    Point3d r1_up_point = new Point3d(p0);
    Point3d r1_low_point = new Point3d(p0);

    double k = Math.Atan2((p0.Y - p1.Y), (p0.X - p1.X));    //求中两个圆心连线的斜率角度
    double centerLine;
    if (p1.Y == p0.Y) //处理斜率为零的情况
    {
      if (p0.X < p1.X)
      {
        centerLine = p0.X - p1.X;

      }
      else
      {
        centerLine = p1.X - p0.X;
      }
    }
    else
    {
      centerLine = (p1.Y - p0.Y) / Math.Sin(k); //求两个圆心连线长度
    }

    double l = Math.Acos((r1 + r1) / centerLine);  //求两个圆心连线和圆心到切点垂线的夹角
    double m = l - k;
    double r2LowX = r1 * Math.Cos(m);
    double r2LowY = r1 * Math.Sin(m);
    double r1UpX = r0 * Math.Cos(m);
    double r1UpY = r0 * Math.Sin(m);
    r2_low_point.X = p1.X - (double)r2LowX;
    r2_low_point.Y = p1.Y + (double)r2LowY;
    r1_up_point.X = p0.X + (double)r1UpX;
    r1_up_point.Y = p0.Y - (double)r1UpY;
    Point2d r2_tempoint = Transition(r2_low_point.X - p1.X, r2_low_point.Y - p1.Y, 2 * l, 1);
    r2_up_point.X = p1.X + r2_tempoint.X;
    r2_up_point.Y = p1.Y + r2_tempoint.Y;
    Point2d r1_tempoint = Transition(r1_up_point.X - p0.X, r1_up_point.Y - p0.Y, 2 * l, 1);
    r1_low_point.X = p0.X + r1_tempoint.X;
    r1_low_point.Y = p0.Y + r1_tempoint.Y;


    l0 = new Line(r1_up_point, r2_low_point).ToNurbsCurve();
    l1 = new Line(r1_low_point, r2_up_point).ToNurbsCurve();


  }
  //点绕点旋转
  private Point2d Transition(double _x, double _y, double _angle, int fx)
  {
    double newX = 0;
    double newY = 0;
    if (fx == 1)
    {
      newX = _x * Math.Cos(_angle) - _y * Math.Sin(_angle);
      newY = _x * Math.Sin(_angle) + _y * Math.Cos(_angle);
    }
    else
    {
      newX = _x * Math.Cos(_angle) + _y * Math.Sin(_angle);
      newY = _y * Math.Cos(_angle) - _x * Math.Sin(_angle);
    }
    return new Point2d((double)newX, (double)newY);
  }
# ---------- end c_script_3 ----------
script_parasite_2 = ScriptParasite(Enable=Toggle(True), Folder=panel)

list_item = ListItem(List=c_script_2.OutPoints, Index=Slider(70, range=0..1000), Wrap=True)
panel_5 = Panel(c_script_3.out)
