# Grasshopper definition visualization.ghx (Grasshopper 1.0.7)

# INPUT
safe_robot_acc = Slider(0.1, range=0..1)
safe_robot_vel = Slider(0.1, range=0..1)
safe_sleep_time = Slider(0.1, range=0..1)
safe_dist = Slider(100, range=50..200)
# WORKING FILES
panel = Panel("\dependencies\master_navigation_data.json")
ghpython_script = GhPythonScript(file_name=panel)  # -> path
# ---------- ghpython_script: Python ----------
a = ghdoc.Path

path = a.split('3d_printing_teamwork')[0]+r'3d_printing_teamwork\\'+file_name
# ---------- end ghpython_script ----------
ghpython_script_2 = GhPythonScript(file_name="/working_file_zac/excution.py")  # -> path; same code as ghpython_script
read_file = ReadFile(File=ghpython_script, PerLineParse=False)
read_file_2 = ReadFile(File=ghpython_script_2, PerLineParse=False)

# ---- group: EXCUTION
python = GhPythonScript(
    Code=read_file_2,
    SAFE_ROBOT_ACC=safe_robot_acc,
    SAFE_ROBOT_VEL=safe_robot_vel,
    SAFE_SLEEP_TIME=safe_sleep_time,
    SAFE_DIST=safe_dist)  # -> Out, Script
